# Dynamo graph pipeToExcel.dyn (Dynamo 2.6.1.8786)

file_path = Filename(".\PipeMiniSchedule.xlsx")
code_block = CodeBlock { "CHWS"; 0; 0; }
select_model_elements_by = DSModelElementsByCategorySelection(index=393)  # "Select Model Elements By Category"; 6 picked in the model
code_block_2 = CodeBlock { "Size"; }
getParameterValueByName = Element.GetParameterValueByName(element=select_model_elements_by, parameterName=code_block_2)
code_block_3 = CodeBlock { "Length"; }
getParameterValueByName_2 = Element.GetParameterValueByName(element=select_model_elements_by, parameterName=code_block_3)
code_block_4 = CodeBlock { "Flow"; }
getParameterValueByName_3 = Element.GetParameterValueByName(element=select_model_elements_by, parameterName=code_block_4)
python_script = Python(IN[0]=getParameterValueByName, IN[1]=getParameterValueByName_2, IN[2]=getParameterValueByName_3)
# ---------- python_script.python (5 lines) ----------
outputList = []
for i in range(0, len(IN[0])):
	outputList.append([IN[0][i].strip('"').replace(' ', '-') + " in", IN[1][i], IN[2][i]])

OUT = outputList
# ----------------------------------------
exportExcel = Data.ExportExcel(filePath=file_path, sheetName=code_block.out0, startRow=code_block.out1, startCol=code_block.out2, data=python_script)
